# Grasshopper definition 251222 tOpos.gh (Grasshopper 1.0.8)
# plug-ins: tOpos

number_slider = Slider(1, range=0..1)
subtraction = Subtraction(A=number_slider, B=Slider(2, range=0..10))
unit_y = UnitY(Factor=subtraction)
unit_z = UnitZ(Factor=number_slider)
brep = Brep([<brep referenced from the Rhino model> x7])
volume_load = VolumeLoad(LoadMesh=brep, LoadVector=unit_y)
brep_2 = Brep(<brep referenced from the Rhino model>)
brep_3 = Brep(<brep referenced from the Rhino model>)
number_slider_2 = Slider(0.1, range=0..0.1)
boundary_domain = BoundaryDomain(DomainMesh=brep_2, DensityValue=1, YoungModul=Slider(30, range=0..100), PoissonNumber=Slider(0.3, range=0..1))
boundary_conditions = BoundaryConditions(Load=volume_load, Support=brep_3)
number_slider_3 = Slider(0.1, range=0..1)
resolution = Resolution(Size=Slider(0.22, range=0..1), sizeModeToggle=True)
model = Model(BoundaryDomain=boundary_domain, BoundaryCondition=boundary_conditions, ModelResolution=resolution, gpuModeToggle=True)  # -> Model, Performance
optimius_parameters = OptimiusParameters(
    OptimisationIteration=Slider(64, range=0..1000),
    VolumeFraction=Slider(0.13, range=0..1),
    Penalty=Domain(2, 3),
    Change=0.005,
    SensitivityFilterRadius=Domain(1.5, 1.5),
    DensityFilterType=0,
    GrayScaleFilter=False,
    HeavisideProjection=0,
    SensitivityFilterType=1)
analyser_parameters = AnalyserParameters(Iterations=4000, Tolerance=0.001)
optimus = Optimus(
    Model=model.Model,
    AnalyserParameters=analyser_parameters,
    OptimusParameters=optimius_parameters,
    SubdivisionThreshold=0.5,
    Reset=Button(),
    Run=Toggle(False),
    optimisationPreviewMode=True,
    solverType=2)  # -> Model, Compliance, Performance
number_slider_4 = Slider(0.5, range=0..1)
number_slider_5 = Slider(0.1, range=0..0.1)
iso_mesh = IsoMesh(Model=optimus.Model, IsoValue=Slider(0.1, range=0..1), Deflection=0)
